vi "CLT.gvi"   [LabVIEW Communications System Design Suite 2.0.1]
panel controls:
  "milliseconds to wait": u32
  "number of bins": i32 = 10
  "number of itr": i32
  "No. Rands per Value": i32
panel indicators:
  "loop iteration": i32
  "histogram": T1
  "mean": f64
  "variance": f64
types:
  T1 = cluster{"x values": f64[], "histogram h(x)": f64[]}
uses:
  NI::Analysis::Statistics::Statistics (1D DBL).gvi
  NI::Analysis::Statistics::Histogram (single-shot)(DBL Array).gvi
diagram:
  s1 = f64[] []  # shift register
  while (iteration -> i1) {
    Wait(time to wait=$"milliseconds to wait")
    w1 = $"No. Rands per Value"
    for (N = w1) {
      for (N = 1) {
        Random Number() -> (number (0 to 1)=w4)
        append w4 to w3
      }
      append w3 to w2
    }
    Add Array Elements(numeric array=w2) -> (sum=w5)
    Multiply(w1, 1) -> w6
    Divide(x=w5, y=w6) -> w7
    Subtract(x=w7, y=0.5) -> w8
    Square Root(x=12) -> w9
    Multiply(w9, 3) -> w10
    Multiply(w8, w10) -> w11
    Insert Into Array(inArray=s1, index0=i1, new=w11) -> w12
    call "Statistics (1D DBL).gvi"(signal=w12) -> (mean=w13, variance=w14)
    $mean <- w13
    $variance <- w14
    Is Greater Or Equal(x=i1, y=$"number of itr") -> w15
    call "Histogram (single-shot)(DBL Array).gvi"(signal=w12, number of bins=$"number of bins") -> (histogram=w16)
    $histogram <- w16
    $"loop iteration" <- i1
    next s1 = w12
    stop if w15
  }
