vi "DataTypes.gvi"   [LabVIEW Communications System Design Suite 2.0.1]
panel controls:
  "string": string
panel indicators:
  "Name in": u8[]
  "converted output": f64[]
  "Avg.Temp(C)": f64
  "Hot?": bool
diagram:
  String Subset(length (rest)=3, offset (0)=0, string=$string) -> w1
  String To Byte Array(string=w1) -> (unsigned byte array=w2)
  $"Name in" <- w2
  Subtract(x=w2, y=32) -> w3
  Divide(x=w3, y=1.8) -> w4
  $"converted output" <- w4
  Array Size(array=w4) -> (size(s)=w5)
  Add Array Elements(numeric array=w4) -> (sum=w6)
  Divide(x=w6, y=w5) -> w7
  $"Avg.Temp(C)" <- w7
  Is Greater Or Equal(x=w7, y=50) -> w8
  $"Hot?" <- w8
