vi "Waveforms.gvi"   [LabVIEW Communications System Design Suite 2.0.1]
panel controls:
  "frequency": f64 = 10
  "amplitude": f64 = 1
  "samples": i32 = 1000
  "sample rate": f64 = 1000
  "amplitude_2": f64 = 1
  "frequency_2": f64 = 10
  "sample rate_2": f64 = 1000
  "samples_2": i32 = 1000
  "amplitude_3": f64 = 1
  "frequency_3": f64 = 10
  "sample rate_3": f64 = 1000
  "samples_3": i32 = 1000
  "order": i32 = 2
  "cutoff frequency": f64 = 0.125
  "low cutoff frequency": f64 = 0.125
  "high cutoff frequency": f64 = 0.45
  "order_2": i32 = 2
panel indicators:
  "Generated PSD": T1
  "Generated Waveform": waveform<f64>
  "Filtered Waveform": waveform<f64>
  "Filtered Waveform PSD": T1
types:
  T1 = cluster{"f0": f64, "df": f64, "magnitude": f64[]}
uses:
  NI::Analysis::Generation::Sine Waveform.gvi
  NI::Analysis::Measurement::Power Spectral Density for 1 Chan.gvi
  NI::Analysis::Filtering::Butterworth Bandpass Filter (Waveform).gvi
  NI::Analysis::Filtering::Butterworth Lowpass Filter (Waveform).gvi
diagram:
  call "Sine Waveform.gvi"(amplitude=$amplitude, frequency=$frequency, sample rate=$"sample rate", samples=$samples) -> (sine wave=w1)
  call "Sine Waveform.gvi"(amplitude=$amplitude_2, frequency=$frequency_2, sample rate=$"sample rate_2", samples=$samples_2) -> (sine wave=w2)
  call "Sine Waveform.gvi"(amplitude=$amplitude_3, frequency=$frequency_3, sample rate=$"sample rate_3", samples=$samples_3) -> (sine wave=w3)
  Waveform Add(w2, w3) -> w4
  Waveform Add(w1, w4) -> w5
  $"Generated Waveform" <- w5
  call "Power Spectral Density for 1 Chan.gvi"(signal=w5) -> (power spectral density=w6)
  $"Filtered Waveform PSD" <- w6
  call "Butterworth Bandpass Filter (Waveform).gvi"(signal=w5, high cutoff frequency=$"high cutoff frequency", low cutoff frequency=$"low cutoff frequency", order=$order_2) -> (filtered signal=w7)
  call "Power Spectral Density for 1 Chan.gvi"(signal=w7) -> (power spectral density=w8)
  $"Generated PSD" <- w8
  $"Filtered Waveform" <- w7
  call "Butterworth Lowpass Filter (Waveform).gvi"(signal=w5, cutoff frequency=$"cutoff frequency", order=$order)
