vi "AM Coherent.gvi"   [LabVIEW Communications System Design Suite 2.0.1]
inputs:
  "AM Signal": waveform<f64> = {dt=1, Y=[]}
  "Carrier": waveform<f64> = {dt=1, Y=[]}
  "cutoff frequency": f64 = 0.125
  "order": i32 = 2
  "error in": error
outputs:
  "Output time domain": waveform<f64>
  "Output signal PSD": T1
  "error out": error
  "DC value": f64
types:
  T1 = cluster{"f0": f64, "df": f64, "magnitude": f64[]}
uses:
  NI::Analysis::Measurement::Peak Amplitude (Wfm).gvi
  NI::Analysis::Filtering::Butterworth Lowpass Filter (Waveform).gvi
  NI::Analysis::Measurement::AC DC and RMS (single-shot)(Wfm).gvi
  NI::Analysis::Measurement::Power Spectral Density for 1 Chan.gvi
diagram:
  call "Peak Amplitude (Wfm).gvi"(signal=$Carrier, error in=$"error in") -> (error out=w1, maximum peak=w2)
  Waveform Divide(error in=w1, x=$Carrier, y=w2) -> (error out=w3, x/y=w4)
  Waveform Multiply(w4, $"AM Signal", error in=w3) -> (error out=w5, o=w6)
  call "Butterworth Lowpass Filter (Waveform).gvi"(signal=w6, cutoff frequency=$"cutoff frequency", error in=w5, order=$order) -> (filtered signal=w7, error out=w8)
  # removes DC
  call "AC DC and RMS (single-shot)(Wfm).gvi"(signal=w7, error in=w8) -> (error out=w9, DC value=w10)
  Waveform Subtract(error in=w9, x=w7, y=w10) -> (error out=w11, x-y=w12)
  # If this doesn't work it might be because we have multiplied by
  # scalar 2 as opposed to a vector of values.
  Waveform Multiply(2, w12, error in=w11) -> (error out=w13, o=w14)
  $"Output time domain" <- w14
  $"DC value" <- w10
  call "Power Spectral Density for 1 Chan.gvi"(signal=w14, error in=w13) -> (power spectral density=w15, error out=w16)
  $"Output signal PSD" <- w15
  Merge Errors(w16) -> (error out=w17)
  $"error out" <- w17
