vi "AM.gvi"   [LabVIEW Communications System Design Suite 2.0.1]
inputs:
  "Message frequency": f64 = 10
  "Message amplitude": f64 = 1
  "Carrier frequency": f64 = 10
  "Carrier amplitude": f64 = 1
  "message sample rate": f64 = 1000
  "message samples": i32 = 1000
  "carrier sample rate": f64 = 1000
  "carrier samples": i32 = 1000
outputs:
  "Message waveform": waveform<f64>
  "Carrier waveform": waveform<f64>
  "AM wave": waveform<f64>
  "Message PSD": f64[]
  "Carrier PSD": f64[]
panel indicators:
  "Modulation index": f64
  "AM PSD": f64[]
uses:
  NI::Analysis::Generation::Sine Waveform.gvi
  NI::Analysis::Measurement::Power Spectrum (DBL).gvi
diagram:
  call "Sine Waveform.gvi"(amplitude=$"Message amplitude", frequency=$"Message frequency", phase in=90, sample rate=$"message sample rate", samples=$"message samples") -> (sine wave=w1)
  $"Message waveform" <- w1
  Divide(x=$"Message amplitude", y=$"Carrier amplitude") -> w2
  $"Modulation index" <- w2
  call "Power Spectrum (DBL).gvi"(signal=w1) -> (power spectrum=w3)
  $"Message PSD" <- w3
  Waveform Add(w1, $"Carrier amplitude") -> w4
  call "Sine Waveform.gvi"(amplitude=$"Carrier amplitude", frequency=$"Carrier frequency", phase in=90, sample rate=$"carrier sample rate", samples=$"carrier samples") -> (sine wave=w5)
  Waveform Divide(x=w5, y=$"Carrier amplitude") -> w6
  Waveform Multiply(w4, w6) -> w7
  $"AM wave" <- w7
  $"Carrier waveform" <- w5
  call "Power Spectrum (DBL).gvi"(signal=w7) -> (power spectrum=w8)
  $"AM PSD" <- w8
  call "Power Spectrum (DBL).gvi"(signal=w5) -> (power spectrum=w9)
  $"Carrier PSD" <- w9
