vi "AMEnvelopeDetection.gvi"   [LabVIEW Communications System Design Suite 2.0.1]
inputs:
  "AM Signal": waveform<f64> = {dt=1, Y=[]}
  "error in": error
  "cutoff frequency": f64 = 0.125
  "order": i32 = 2
outputs:
  "Output signal PSD": T1
  "Output time domain": waveform<f64>
  "error out": error
types:
  T1 = cluster{"f0": f64, "df": f64, "magnitude": f64[]}
uses:
  NI::Analysis::Filtering::Butterworth Lowpass Filter (Waveform).gvi
  NI::Analysis::Measurement::AC DC and RMS (single-shot)(Wfm).gvi
  NI::Analysis::Measurement::Power Spectral Density for 1 Chan.gvi
diagram:
  Waveform Multiply(3.1415926, $"AM Signal", error in=$"error in") -> (error out=w1, o=w2)
  Property Node(instance in=w2) -> ("Y"=w3, "t0"=w4, "dt"=w5)
  for {
    w6 = each element of w3
    Is Greater Or Equal(x=0, y=w6) -> w8
    case (w8) {
      frame False, Default {
        Multiply(w6, 0) -> w9
      }
      frame True {
        w9 = w6
      }
    }
    append w9 to w7
  }
  Build Waveform Node(Y=w7, dt=w5, t0=w4) -> (output waveform=w10)
  call "Butterworth Lowpass Filter (Waveform).gvi"(signal=w10, cutoff frequency=$"cutoff frequency", error in=w1, order=$order) -> (filtered signal=w11, error out=w12)
  call "AC DC and RMS (single-shot)(Wfm).gvi"(signal=w11, error in=w12) -> (error out=w13, DC value=w14)
  Waveform Subtract(error in=w13, x=w11, y=w14) -> (error out=w15, x-y=w16)
  $"Output time domain" <- w16
  call "Power Spectral Density for 1 Chan.gvi"(signal=w16, error in=w15) -> (power spectral density=w17, error out=w18)
  $"Output signal PSD" <- w17
  Merge Errors(w18) -> (error out=w19)
  $"error out" <- w19
