vi "AMTopLevel.gvi"   [LabVIEW Communications System Design Suite 2.0.1]
panel controls:
  "Message frequency": f64 = 10
  "Message amplitude": f64 = 1
  "Carrier frequency": f64 = 10
  "Carrier amplitude": f64 = 1
  "message sample rate": f64 = 1000
  "message samples": i32 = 1000
  "carrier sample rate": f64 = 1000
  "carrier samples": i32 = 1000
  "cutoff frequency": f64 = 0.125
  "order": i32 = 2
  "stop": bool
panel indicators:
  "Message waveform": waveform<f64>
  "Carrier waveform": waveform<f64>
  "Coherent Output time domain": waveform<f64>
  "AM wave": waveform<f64>
  "Envelope Output time domain": waveform<f64>
  "Coherent output PSD": T1
  "envelope detection output PSD": T1
types:
  T1 = cluster{"f0": f64, "df": f64, "magnitude": f64[]}
diagram:
  while {
    call "AM.gvi"(Message frequency=$"Message frequency", Message amplitude=$"Message amplitude", Carrier frequency=$"Carrier frequency", Carrier amplitude=$"Carrier amplitude", message sample rate=$"message sample rate", message samples=$"message samples", carrier sample rate=$"carrier sample rate", carrier samples=$"carrier samples") -> (Message waveform=w1, Carrier waveform=w2, AM wave=w3)
    $"Message waveform" <- w1
    $"Carrier waveform" <- w2
    call "AMEnvelopeDetection.gvi"(AM Signal=w3, cutoff frequency=$"cutoff frequency", order=$order) -> (Output signal PSD=w4, Output time domain=w5)
    $"envelope detection output PSD" <- w4
    $"AM wave" <- w3
    $"Envelope Output time domain" <- w5
    call "AM Coherent.gvi"(AM Signal=w3, Carrier=w2, cutoff frequency=$"cutoff frequency", order=$order) -> (Output time domain=w6, Output signal PSD=w7)
    $"Coherent Output time domain" <- w6
    $"Coherent output PSD" <- w7
    stop if $stop
  }
