vi "FMDemodulator.gvi"   [LabVIEW Communications System Design Suite 2.0.1]
inputs:
  "FM signal input": waveform<f64> = {dt=1, Y=[]}
  "error in": error
  "order": i32 = 2
  "cutoff frequency": f64 = 0.125
outputs:
  "Output signal PSD": T1
  "Output time domain": waveform<f64>
  "error out": error
types:
  T1 = cluster{"f0": f64, "df": f64, "magnitude": f64[]}
uses:
  NI::Analysis::IntegralDifferentiation::Derivative x(t).gvi
diagram:
  Property Node(instance in=$"FM signal input") -> ("Y"=w1, "t0"=w2, "dt"=w3)
  call "Derivative x(t).gvi"(x(t)=w1, dt=w3, error in=$"error in") -> (error out=w4, dx(t)/dt=w5)
  Build Waveform Node(Y=w5, dt=w3, t0=w2) -> (output waveform=w6)
  call "AMEnvelopeDetection.gvi"(AM Signal=w6, error in=w4, cutoff frequency=$"cutoff frequency", order=$order) -> (Output signal PSD=w7, Output time domain=w8, error out=w9)
  $"Output signal PSD" <- w7
  $"Output time domain" <- w8
  $"error out" <- w9
