vi "FMTopLevel.gvi"   [LabVIEW Communications System Design Suite 2.0.1]
panel controls:
  "message amplitude": f64 = 1
  "message frequency": f64 = 10
  "carrier frequency": f64 = 10
  "carrier amplitude": f64 = 1
  "samples": i32 = 1000
  "sample rate": f64 = 1000
  "stop": bool
  "order": i32 = 2
  "cutoff frequency": f64 = 0.125
  "Kf": f64
panel indicators:
  "Output time domain": waveform<f64>
  "FM modulated waveform": waveform<f64>
  "PSD demodulated waveform": T1
  "message signal": waveform<f64>
types:
  T1 = cluster{"f0": f64, "df": f64, "magnitude": f64[]}
uses:
  NI::Analysis::Measurement::Power Spectral Density for 1 Chan.gvi
diagram:
  w1 = $Kf
  w2 = $order
  w3 = $"carrier frequency"
  w4 = $"cutoff frequency"
  w5 = $"sample rate"
  w6 = $samples
  w7 = $"message amplitude"
  w8 = $"message frequency"
  w9 = $"carrier amplitude"
  while {
    Multiply(w9, w1) -> w10
    call "FM_Modulator.gvi"(message amplitude=w7, Kf=w1, message frequency=w8, samples=w6, sample rate=w5, carrier frequency=w3, carrier amplitude=w9) -> (FM modulated waveform=w11, message signal=w12)
    call "FMDemodulator.gvi"(FM signal input=w11, order=w2, cutoff frequency=w4) -> (Output time domain=w13)
    Waveform Divide(x=w13, y=w10) -> w14
    Waveform Divide(x=w14, y=PiTimes2) -> w15
    call "Power Spectral Density for 1 Chan.gvi"(signal=w15) -> (power spectral density=w16)
    stop if $stop
  }
  $"FM modulated waveform" <- w11
  $"Output time domain" <- w15
  $"PSD demodulated waveform" <- w16
  $"message signal" <- w12
