vi "FM_Modulator.gvi"   [LabVIEW Communications System Design Suite 2.0.1]
inputs:
  "message amplitude": f64 = 1
  "error in": error
  "Kf": f64
  "message frequency": f64 = 10
  "samples": i32 = 1000
  "sample rate": f64 = 1000
  "carrier frequency": f64 = 10
  "carrier amplitude": f64 = 1
outputs:
  "FM modulated waveform": waveform<f64>
  "error out": error
  "PSD of Waveform": T1
  "message signal": waveform<f64>
types:
  T1 = cluster{"f0": f64, "df": f64, "magnitude": f64[]}
uses:
  NI::Analysis::Generation::Sine Waveform.gvi
  NI::Analysis::IntegralDifferentiation::Integral x(t).gvi
  NI::Analysis::Measurement::Power Spectral Density for 1 Chan.gvi
diagram:
  call "Sine Waveform.gvi"(amplitude=$"message amplitude", frequency=$"message frequency", error in=$"error in", sample rate=$"sample rate", samples=$samples) -> (sine wave=w1, error out=w2)
  $"message signal" <- w1
  call "Sine Waveform.gvi"(amplitude=$"carrier amplitude", frequency=$"carrier frequency", sample rate=$"sample rate", samples=$samples) -> (sine wave=w3, error out=w4)
  call "Sine Waveform.gvi"(amplitude=$"carrier amplitude", frequency=$"carrier frequency", phase in=90, sample rate=$"sample rate", samples=$samples) -> (sine wave=w5, error out=w6)
  Merge Errors(w6, w4) -> (error out=w7)
  Property Node(instance in=w1) -> ("Y"=w8, "t0"=w9, "dt"=w10)
  call "Integral x(t).gvi"(x(t)=w8, dt=w10, error in=w2) -> (error out=w11, integral x(t)=w12)
  Merge Errors(w11, w7) -> (error out=w13)
  Multiply(w12, $Kf) -> w14
  Multiply(w14, PiTimes2) -> w15
  Sine And Cosine(x=w15) -> (cos(x)=w16, sin(x)=w17)
  Build Waveform Node(Y=w17, dt=w10, t0=w9) -> (output waveform=w18)
  Waveform Multiply(w18, w3, error in=w13) -> (error out=w19, o=w20)
  Build Waveform Node(Y=w16, dt=w10, t0=w9) -> (output waveform=w21)
  Waveform Multiply(w21, w5, error in=w19) -> (error out=w22, o=w23)
  Waveform Subtract(error in=w22, x=w23, y=w20) -> (error out=w24, x-y=w25)
  $"FM modulated waveform" <- w25
  call "Power Spectral Density for 1 Chan.gvi"(signal=w25, error in=w24) -> (power spectral density=w26, error out=w27)
  $"PSD of Waveform" <- w26
  $"error out" <- w27
