vi "BPSK_FEC.gvi"   [LabVIEW Communications System Design Suite 2.0.1]
panel controls:
  "IQ rate": f64 = 200000
  "device names": "niUSRPClass"
  "carrier frequency": f64 = 400000000
  "gain Tx": f64
  "active antenna Tx": string = "TX1"
  "stop Tx": bool
  "gain Rx": f64
  "active antenna Rx": string = "RX2"
  "total bits": i32 = 128
  "Symbol Rate": f64
  "pulse shaping filter": T2 = "none"
panel indicators:
  "Baseband Waveform": waveform<f64>
  "Baseband Power Spectrum": T1
  "Baseband Output": waveform<f64>
  "output baseband Power Spectrum": T1
  "Number of Errors": f64
  "size(s)": i32
  "product": i32
  "input bit stream": i8[]
  "output bit stream": i16[]
  "random number": f64
  "BER x / y": f64
  "Number of received": i32
types:
  T1 = cluster{"f0": f64, "df": f64, "magnitude": f64[]}
  T2 = enum{"none", "Raised Cosine", "Root Raised Cos", "Gaussian"}
uses:
  NI::Analysis::Resampling::Upsample (DBL).gvi
  NI::Analysis::Operations::1D Convolution (DBL).gvi
  NI::Analysis::Resampling::Decimate (single shot, CDB).gvi
diagram:
  while {
    Random Number() -> (number (0 to 1)=w1)
    Is Greater(x=w1, y=0.5) -> w2
    stop if w2
  }
  call "MT Generate Bits (Fibonacci, PN Order).gvi"(total bits=$"total bits", seed in=w1) -> (output bit stream=w3)
  Build Array[ConcatenateInputs=True](w3, w3, w3) -> w4
  $"input bit stream" <- w4
  Reciprocal(x=$"IQ rate") -> w5
  w6 = cluster{"t0": timestamp, "dt": f64, "Y": c128[]} {all zero or empty}
  Multiply(w4, 2) -> w7
  Subtract(x=w7, y=1) -> w8
  call "AddFrameHeader.gvi"(array=w8) -> (output array=w9)
  Reciprocal(x=$"Symbol Rate") -> w10
  Multiply(w10, $"IQ rate") -> w11
  To Long Integer(number=w11) -> w12
  call "Upsample (DBL).gvi"(input array=w9, upsampling factor=w12) -> (upsampled array=w13)
  call "MT Generate Filter Coefficients.gvi"(pulse shaping filter=$"pulse shaping filter", pulse shaping samples per symbol=w12, modulation type="PSK") -> (pulse shaping filter coefficients=w14)
  call "1D Convolution (DBL).gvi"(x=w13, y=w14) -> (x * y=w15)
  call "Quick Scale 1D.gvi"(X=w15) -> (Y[i]=X[i]/Max|X|=w16)
  To Double Precision Complex(number=w16) -> w17
  Property Node(instance in=w6, "dt"=w5, "Y"=w17) -> (instance out=w18)
  call "FFT Power Spectrum for 1 Chan (CDB)2.gvi"(time signal=w18, dB On (F)=TRUE) -> (power spectrum=w19)
  $"Baseband Power Spectrum" <- w19
  Build Waveform Node(Y=w16, dt=w5) -> (output waveform=w20)
  $"Baseband Waveform" <- w20
  $"random number" <- w1
  call "Insert Pilots.gvi"(signal input=w17) -> (output signal=w21)
  call "AddFrameHeader (complex).gvi"(array=w21) -> (output array=w22)
  Array Size(array=w22) -> (size(s)=w23)
  $"size(s)" <- w23
  Multiply(w23, 23) -> w24
  $product <- w24
  call "niUSRP Open Rx Session.gvi"(device names=$"device names") -> (error out=w25, session handle out=w26)
  call "niUSRP Configure Signal.gvi"(session handle=w26, IQ rate=$"IQ rate", carrier frequency=$"carrier frequency", gain=$"gain Rx", error in=w25, active antenna=$"active antenna Rx") -> (session handle out=w27, coerced carrier frequency=w28, error out=w29)
  Subtract(x=w28, y=20000) -> w30
  Property Node(instance in=w27, "LO Frequency"=w30) -> (instance out=w31)
  call "niUSRP Initiate.gvi"(session handle=w31, error in=w29) -> (session handle out=w32, error out=w33)
  call "niUSRP Fetch Rx Data (CDB).gvi"(session handle=w32, number of samples=w24, error in=w33) -> (session handle out=w34, data=w35, error out=w36)
  call "niUSRP Close Session.gvi"(session handle=w34, error in=w36)
  Reciprocal(x=$"IQ rate") -> w37
  call "MT Generate Filter Coefficients.gvi"(pulse shaping filter="Root Raised Cos", matched samples per symbol=w12, modulation type="PSK") -> (matched filter coefficients=w38)
  call "FrameSync.gvi"(Sampled Input=w35) -> (Aligned Samples=w39)
  call "Channel Estimator.gvi"(input signal=w39) -> (signal out=w40)
  Complex To Real Imaginary(x + iy=w40) -> (x=w41)
  call "1D Convolution (DBL).gvi"(x=w41, y=w38) -> (x * y=w42)
  Build Waveform Node(Y=w42, dt=w37) -> (output waveform=w43)
  $"Baseband Output" <- w43
  w44 = cluster{"t0": timestamp, "dt": f64, "Y": c128[]} {all zero or empty}
  Property Node(instance in=w44, "dt"=w37, "Y"=w42) -> (instance out=w45)
  call "FFT Power Spectrum for 1 Chan (CDB)2.gvi"(time signal=w45, dB On (F)=TRUE) -> (power spectrum=w46)
  $"output baseband Power Spectrum" <- w46
  call "niUSRP Open Tx Session.gvi"(device names=$"device names") -> (session handle out=w47, error out=w48)
  call "niUSRP Configure Signal.gvi"(session handle=w47, IQ rate=$"IQ rate", carrier frequency=$"carrier frequency", gain=$"gain Tx", error in=w48, active antenna=$"active antenna Tx") -> (session handle out=w49, error out=w50)
  while {
    call "niUSRP Write Tx Data (CDB).gvi"(session handle=w49, data=w22, error in=w50) -> (session handle out=w51, error out=w52)
    stop if $"stop Tx"
  }
  call "niUSRP Close Session.gvi"(session handle=w51, error in=w52)
  # Because we tripled the size of the data by concatenating
  # three data sets...
  Multiply($"total bits", 3) -> w53
  call "PulseAlign.gvi"(Input signal=w42, Receiver Sampling Factor=w12) -> (aligned output=w54)
  call "Decimate (single shot, CDB).gvi"(input array=w54, decimating factor=w12) -> (decimated array=w55)
  call "FrameSync.gvi"(Sampled Input=w55) -> (Aligned Samples=w56)
  Complex To Real Imaginary(x + iy=w56) -> (x=w57)
  for {
    w58 = each element of w57
    Is Greater Than 0(x=w58) -> w60
    Boolean To Integer(Boolean=w60) -> (0, 1=w61)
    append w61 to w59
  }
  Array Subset(array=w59, index0=0, length0=w53) -> w62
  $"output bit stream" <- w62
  call "FEC Decoder.gvi"(data_in=w62) -> (output=w63)
  Array Size(array=w63) -> (size(s)=w64)
  # w3: Input Bit Stream
  $"Number of received" <- w64
  # $"total bits": Number of bits (single bit stream)
  s1 = 0  # shift register
  for (N = w64) {
    w65 = each element of w63
    w66 = each element of w3
    Is Not Equal(x=w66, y=w65) -> w67
    case (w67) {
      frame False, Default {
        w68 = s1
      }
      frame True {
        Increment(x=s1) -> w68
      }
    }
    next s1 = w68
  }
  $"Number of Errors" <- s1
  Divide(x=s1, y=$"total bits") -> w69
  $"BER x / y" <- w69
