vi "BPSK_Tx_Rx.gvi"   [LabVIEW Communications System Design Suite 2.0.1]
panel controls:
  "IQ rate": f64 = 200000
  "device names": "niUSRPClass"
  "carrier frequency": f64 = 400000000
  "gain Tx": f64
  "active antenna Tx": string = "TX1"
  "stop Tx": bool
  "gain Rx": f64
  "active antenna Rx": string = "RX2"
  "total bits": i32 = 128
  "Symbol Rate": f64
  "pulse shaping filter": T2 = "none"
panel indicators:
  "Baseband Waveform": waveform<f64>
  "Baseband Power Spectrum": T1
  "Baseband Output": waveform<f64>
  "output baseband Power Spectrum": T1
  "trigger found?": bool
  "BER": f64
  "size(s)": i32
  "product": i32
  "input bit stream": i8[]
  "output bit stream": i16[]
  "random number": f64
types:
  T1 = cluster{"f0": f64, "df": f64, "magnitude": f64[]}
  T2 = enum{"none", "Raised Cosine", "Root Raised Cos", "Gaussian"}
uses:
  NI::Analysis::Resampling::Upsample (DBL).gvi
  NI::Analysis::Operations::1D Convolution (DBL).gvi
  NI::Analysis::Resampling::Decimate (single shot, CDB).gvi
diagram:
  while {
    Random Number() -> (number (0 to 1)=w1)
    Is Greater(x=w1, y=0.5) -> w2
    stop if w2
  }
  call "MT Generate Bits (Fibonacci, PN Order).gvi"(total bits=$"total bits", seed in=w1) -> (output bit stream=w3)
  $"input bit stream" <- w3
  Reciprocal(x=$"IQ rate") -> w4
  w5 = cluster{"t0": timestamp, "dt": f64, "Y": c128[]} {all zero or empty}
  Multiply(w3, 2) -> w6
  Subtract(x=w6, y=1) -> w7
  call "AddFrameHeader.gvi"(array=w7) -> (output array=w8)
  Reciprocal(x=$"Symbol Rate") -> w9
  Multiply(w9, $"IQ rate") -> w10
  To Long Integer(number=w10) -> w11
  call "Upsample (DBL).gvi"(input array=w8, upsampling factor=w11) -> (upsampled array=w12)
  call "MT Generate Filter Coefficients.gvi"(pulse shaping filter=$"pulse shaping filter", pulse shaping samples per symbol=w11, modulation type="PSK") -> (pulse shaping filter coefficients=w13)
  call "1D Convolution (DBL).gvi"(x=w12, y=w13) -> (x * y=w14)
  call "Quick Scale 1D.gvi"(X=w14) -> (Y[i]=X[i]/Max|X|=w15)
  To Double Precision Complex(number=w15) -> w16
  Property Node(instance in=w5, "dt"=w4, "Y"=w16) -> (instance out=w17)
  call "FFT Power Spectrum for 1 Chan (CDB)2.gvi"(time signal=w17, dB On (F)=TRUE) -> (power spectrum=w18)
  $"Baseband Power Spectrum" <- w18
  $"random number" <- w1
  Build Waveform Node(Y=w15, dt=w4) -> (output waveform=w19)
  $"Baseband Waveform" <- w19
  call "Insert Pilots.gvi"(signal input=w16) -> (output signal=w20)
  call "AddFrameHeader (complex).gvi"(array=w20) -> (output array=w21)
  Array Size(array=w21) -> (size(s)=w22)
  $"size(s)" <- w22
  call "MT Generate Filter Coefficients.gvi"(pulse shaping filter="Root Raised Cos", matched samples per symbol=w11, modulation type="PSK") -> (matched filter coefficients=w23)
  call "niUSRP Open Rx Session.gvi"(device names=$"device names") -> (error out=w24, session handle out=w25)
  call "niUSRP Configure Signal.gvi"(session handle=w25, IQ rate=$"IQ rate", carrier frequency=$"carrier frequency", gain=$"gain Rx", error in=w24, active antenna=$"active antenna Rx") -> (session handle out=w26, coerced carrier frequency=w27, error out=w28)
  Subtract(x=w27, y=20000) -> w29
  Property Node(instance in=w26, "LO Frequency"=w29) -> (instance out=w30)
  call "niUSRP Initiate.gvi"(session handle=w30, error in=w28) -> (session handle out=w31, error out=w32)
  Multiply(w22, 23) -> w33
  call "niUSRP Fetch Rx Data (CDB).gvi"(session handle=w31, number of samples=w33, error in=w32) -> (session handle out=w34, data=w35, error out=w36)
  call "FrameSync.gvi"(Sampled Input=w35) -> (Aligned Samples=w37)
  call "Channel Estimator.gvi"(input signal=w37) -> (signal out=w38)
  Complex To Real Imaginary(x + iy=w38) -> (x=w39)
  call "1D Convolution (DBL).gvi"(x=w39, y=w23) -> (x * y=w40)
  call "PulseAlign.gvi"(Input signal=w40, Receiver Sampling Factor=w11) -> (aligned output=w41)
  call "Decimate (single shot, CDB).gvi"(input array=w41, decimating factor=w11) -> (decimated array=w42)
  call "FrameSync.gvi"(Sampled Input=w42) -> (Aligned Samples=w43)
  Complex To Real Imaginary(x + iy=w43) -> (x=w44)
  for {
    w45 = each element of w44
    Is Greater Than 0(x=w45) -> w47
    Boolean To Integer(Boolean=w47) -> (0, 1=w48)
    append w48 to w46
  }
  Array Subset(array=w46, index0=0, length0=$"total bits") -> w49
  $"output bit stream" <- w49
  $product <- w33
  call "niUSRP Close Session.gvi"(session handle=w34, error in=w36)
  call "MT Calculate BER After Trigger (Fibonacci PN Sequence).gvi"(input bit stream=w49, BER trigger threshold=0.4) -> (BER=w50, trigger found?=w51)
  $BER <- w50
  $"trigger found?" <- w51
  call "niUSRP Open Tx Session.gvi"(device names=$"device names") -> (session handle out=w52, error out=w53)
  call "niUSRP Configure Signal.gvi"(session handle=w52, IQ rate=$"IQ rate", carrier frequency=$"carrier frequency", gain=$"gain Tx", error in=w53, active antenna=$"active antenna Tx") -> (session handle out=w54, error out=w55)
  while {
    call "niUSRP Write Tx Data (CDB).gvi"(session handle=w54, data=w21, error in=w55) -> (session handle out=w56, error out=w57)
    stop if $"stop Tx"
  }
  call "niUSRP Close Session.gvi"(session handle=w56, error in=w57)
  Reciprocal(x=$"IQ rate") -> w58
  Build Waveform Node(Y=w40, dt=w58) -> (output waveform=w59)
  $"Baseband Output" <- w59
  w60 = cluster{"t0": timestamp, "dt": f64, "Y": c128[]} {all zero or empty}
  Property Node(instance in=w60, "dt"=w58, "Y"=w40) -> (instance out=w61)
  call "FFT Power Spectrum for 1 Chan (CDB)2.gvi"(time signal=w61, dB On (F)=TRUE) -> (power spectrum=w62)
  $"output baseband Power Spectrum" <- w62
