vi "BPSK_Tx_Rx_Template.gvi"   [LabVIEW Communications System Design Suite 2.0.1]
panel controls:
  "IQ rate": f64 = 200000
  "device names": "niUSRPClass"
  "carrier frequency": f64 = 400000000
  "gain Tx": f64
  "active antenna Tx": string = "TX1"
  "stop Tx": bool
  "gain Rx": f64
  "active antenna Rx": string = "RX2"
  "total bits": i32 = 128
  "Symbol Rate": f64
  "pulse shaping filter": T2 = "none"
panel indicators:
  "Baseband Waveform": waveform<f64>
  "Baseband Power Spectrum": T1
  "Baseband Output": waveform<f64>
  "output baseband Power Spectrum": T1
  "trigger found?": bool
  "BER": f64
  "size(s)": i32
  "product": i32
  "input bit stream": i8[]
  "output bit stream": i16[]
  "random number": f64
types:
  T1 = cluster{"f0": f64, "df": f64, "magnitude": f64[]}
  T2 = enum{"none", "Raised Cosine", "Root Raised Cos", "Gaussian"}
uses:
  NI::Analysis::Resampling::Upsample (DBL).gvi
  NI::Analysis::Operations::1D Convolution (DBL).gvi
  NI::Analysis::Resampling::Decimate (single shot, CDB).gvi
diagram:
  while {
    Random Number() -> (number (0 to 1)=w1)
    Is Greater(x=w1, y=0.5) -> w2
    stop if w2
  }
  call "MT Generate Bits (Fibonacci, PN Order).gvi"(total bits=$"total bits", seed in=w1) -> (output bit stream=w3)
  $"input bit stream" <- w3
  Reciprocal(x=$"IQ rate") -> w4
  w5 = cluster{"t0": timestamp, "dt": f64, "Y": c128[]} {all zero or empty}
  Multiply(w3, 2) -> w6
  Subtract(x=w6, y=1) -> w7
  call "AddFrameHeader.gvi"(array=w7) -> (output array=w8)
  Reciprocal(x=$"Symbol Rate") -> w9
  Multiply(w9, $"IQ rate") -> w10
  To Long Integer(number=w10) -> w11
  call "Upsample (DBL).gvi"(input array=w8, upsampling factor=w11) -> (upsampled array=w12)
  call "MT Generate Filter Coefficients.gvi"(pulse shaping filter=$"pulse shaping filter", pulse shaping samples per symbol=w11, modulation type="PSK") -> (pulse shaping filter coefficients=w13)
  call "1D Convolution (DBL).gvi"(x=w12, y=w13) -> (x * y=w14)
  call "Quick Scale 1D.gvi"(X=w14) -> (Y[i]=X[i]/Max|X|=w15)
  To Double Precision Complex(number=w15) -> w16
  Property Node(instance in=w5, "dt"=w4, "Y"=w16) -> (instance out=w17)
  call "FFT Power Spectrum for 1 Chan (CDB)2.gvi"(time signal=w17, dB On (F)=TRUE) -> (power spectrum=w18)
  $"Baseband Power Spectrum" <- w18
  $"random number" <- w1
  Build Waveform Node(Y=w15, dt=w4) -> (output waveform=w19)
  $"Baseband Waveform" <- w19
  call "Insert Pilots.gvi"(signal input=w16) -> (output signal=w20)
  call "AddFrameHeader (complex).gvi"(array=w20) -> (output array=w21)
  Array Size(array=w21) -> (size(s)=w22)
  $"size(s)" <- w22
  Multiply(w22, 23) -> w23
  $product <- w23
  call "niUSRP Open Rx Session.gvi"(device names=$"device names") -> (error out=w24, session handle out=w25)
  call "niUSRP Configure Signal.gvi"(session handle=w25, IQ rate=$"IQ rate", carrier frequency=$"carrier frequency", gain=$"gain Rx", error in=w24, active antenna=$"active antenna Rx") -> (session handle out=w26, coerced carrier frequency=w27, error out=w28)
  Subtract(x=w27, y=20000) -> w29
  Property Node(instance in=w26, "LO Frequency"=w29) -> (instance out=w30)
  call "niUSRP Initiate.gvi"(session handle=w30, error in=w28) -> (session handle out=w31, error out=w32)
  call "niUSRP Fetch Rx Data (CDB).gvi"(session handle=w31, number of samples=w23, error in=w32) -> (session handle out=w33, data=w34, error out=w35)
  call "niUSRP Close Session.gvi"(session handle=w33, error in=w35)
  call "niUSRP Open Tx Session.gvi"(device names=$"device names") -> (session handle out=w36, error out=w37)
  call "niUSRP Configure Signal.gvi"(session handle=w36, IQ rate=$"IQ rate", carrier frequency=$"carrier frequency", gain=$"gain Tx", error in=w37, active antenna=$"active antenna Tx") -> (session handle out=w38, error out=w39)
  while {
    call "niUSRP Write Tx Data (CDB).gvi"(session handle=w38, data=w21, error in=w39) -> (session handle out=w40, error out=w41)
    stop if $"stop Tx"
  }
  call "niUSRP Close Session.gvi"(session handle=w40, error in=w41)
  Reciprocal(x=$"IQ rate") -> w42
  call "MT Generate Filter Coefficients.gvi"(pulse shaping filter="Root Raised Cos", matched samples per symbol=w11, modulation type="PSK") -> (matched filter coefficients=w43)
  call "FrameSync.gvi"(Sampled Input=w34) -> (Aligned Samples=w44)
  call "Channel Estimator.gvi"(input signal=w44) -> (signal out=w45)
  Complex To Real Imaginary(x + iy=w45) -> (x=w46)
  call "1D Convolution (DBL).gvi"(x=w46, y=w43) -> (x * y=w47)
  Build Waveform Node(Y=w47, dt=w42) -> (output waveform=w48)
  $"Baseband Output" <- w48
  w49 = cluster{"t0": timestamp, "dt": f64, "Y": c128[]} {all zero or empty}
  Property Node(instance in=w49, "dt"=w42, "Y"=w47) -> (instance out=w50)
  call "FFT Power Spectrum for 1 Chan (CDB)2.gvi"(time signal=w50, dB On (F)=TRUE) -> (power spectrum=w51)
  $"output baseband Power Spectrum" <- w51
  call "PulseAlign.gvi"(Input signal=w47, Receiver Sampling Factor=w11) -> (aligned output=w52)
  call "Decimate (single shot, CDB).gvi"(input array=w52, decimating factor=w11) -> (decimated array=w53)
  call "FrameSync.gvi"(Sampled Input=w53) -> (Aligned Samples=w54)
  Complex To Real Imaginary(x + iy=w54) -> (x=w55)
  for {
    w56 = each element of w55
    Is Greater Than 0(x=w56) -> w58
    Boolean To Integer(Boolean=w58) -> (0, 1=w59)
    append w59 to w57
  }
  Array Subset(array=w57, index0=0, length0=$"total bits") -> w60
  $"output bit stream" <- w60
  call "MT Calculate BER After Trigger (Fibonacci PN Sequence).gvi"(input bit stream=w60, BER trigger threshold=0.4) -> (BER=w61, trigger found?=w62)
  $BER <- w61
  $"trigger found?" <- w62
