vi "DPSK_Tx_Rx_Template.gvi"   [LabVIEW Communications System Design Suite 2.0.1]
panel controls:
  "IQ rate": f64 = 200000
  "device names": "niUSRPClass"
  "carrier frequency": f64 = 400000000
  "gain Tx": f64
  "active antenna Tx": string = "TX1"
  "stop Tx": bool
  "gain Rx": f64
  "active antenna Rx": string = "RX2"
  "total bits": i32 = 128
  "Symbol Rate": f64
  "pulse shaping filter": T2 = "none"
panel indicators:
  "Baseband Waveform": waveform<f64>
  "Baseband Power Spectrum": T1
  "Baseband Output": waveform<c128>
  "output baseband Power Spectrum": T1
  "trigger found?": bool
  "BER": f64
  "size(s)": i32
  "product": i32
  "input bit stream": i8[]
  "output bit stream": i16[]
  "random number": f64
types:
  T1 = cluster{"f0": f64, "df": f64, "magnitude": f64[]}
  T2 = enum{"none", "Raised Cosine", "Root Raised Cos", "Gaussian"}
uses:
  NI::Analysis::Resampling::Upsample (DBL).gvi
  NI::Analysis::Operations::1D Convolution (DBL).gvi
  NI::Analysis::Operations::1D Convolution (CDB).gvi
  NI::Analysis::Resampling::Decimate (single shot, CDB).gvi
diagram:
  while {
    Random Number() -> (number (0 to 1)=w1)
    Is Greater(x=w1, y=0.5) -> w2
    stop if w2
  }
  call "MT Generate Bits (Fibonacci, PN Order).gvi"(total bits=$"total bits", seed in=w1) -> (output bit stream=w3)
  $"input bit stream" <- w3
  $"random number" <- w1
  Reciprocal(x=$"IQ rate") -> w4
  w5 = cluster{"t0": timestamp, "dt": f64, "Y": c128[]} {all zero or empty}
  Reciprocal(x=$"Symbol Rate") -> w6
  Multiply(w6, $"IQ rate") -> w7
  call "MT Generate Filter Coefficients.gvi"(pulse shaping filter=$"pulse shaping filter", pulse shaping samples per symbol=w7, modulation type="PSK") -> (pulse shaping filter coefficients=w8)
  Multiply(w3, 2) -> w9
  Subtract(x=w9, y=1) -> w10
  call "AddFrameHeader.gvi"(array=w10) -> (output array=w11)
  s1 = 1  # shift register
  for {
    w12 = each element of w11
    Multiply(w12, s1) -> w14
    append w14 to w13
    next s1 = w14
  }
  call "Upsample (DBL).gvi"(input array=w13, upsampling factor=w7) -> (upsampled array=w15)
  call "1D Convolution (DBL).gvi"(x=w15, y=w8) -> (x * y=w16)
  call "Quick Scale 1D.gvi"(X=w16) -> (Y[i]=X[i]/Max|X|=w17)
  To Double Precision Complex(number=w17) -> w18
  Property Node(instance in=w5, "dt"=w4, "Y"=w18) -> (instance out=w19)
  call "FFT Power Spectrum for 1 Chan (CDB)2.gvi"(time signal=w19, dB On (F)=TRUE) -> (power spectrum=w20)
  $"Baseband Power Spectrum" <- w20
  Build Waveform Node(Y=w17, dt=w4) -> (output waveform=w21)
  $"Baseband Waveform" <- w21
  Array Size(array=w18) -> (size(s)=w22)
  $"size(s)" <- w22
  Multiply(w22, 23) -> w23
  $product <- w23
  call "niUSRP Open Rx Session.gvi"(device names=$"device names") -> (error out=w24, session handle out=w25)
  call "niUSRP Configure Signal.gvi"(session handle=w25, IQ rate=$"IQ rate", carrier frequency=$"carrier frequency", gain=$"gain Rx", error in=w24, active antenna=$"active antenna Rx") -> (session handle out=w26, coerced carrier frequency=w27, error out=w28)
  Subtract(x=w27, y=20000) -> w29
  Property Node(instance in=w26, "LO Frequency"=w29) -> (instance out=w30)
  call "niUSRP Initiate.gvi"(session handle=w30, error in=w28) -> (session handle out=w31, error out=w32)
  call "niUSRP Fetch Rx Data (CDB).gvi"(session handle=w31, number of samples=1000000, error in=w32) -> (session handle out=w33, data=w34, error out=w35)
  call "niUSRP Close Session.gvi"(session handle=w33, error in=w35)
  call "niUSRP Open Tx Session.gvi"(device names=$"device names") -> (session handle out=w36, error out=w37)
  call "niUSRP Configure Signal.gvi"(session handle=w36, IQ rate=$"IQ rate", carrier frequency=$"carrier frequency", gain=$"gain Tx", error in=w37, active antenna=$"active antenna Tx") -> (session handle out=w38, error out=w39)
  while {
    call "niUSRP Write Tx Data (CDB).gvi"(session handle=w38, data=w18, error in=w39) -> (session handle out=w40, error out=w41)
    stop if $"stop Tx"
  }
  call "niUSRP Close Session.gvi"(session handle=w40, error in=w41)
  Reciprocal(x=$"IQ rate") -> w42
  call "MT Generate Filter Coefficients.gvi"(pulse shaping filter="Root Raised Cos", matched samples per symbol=w7, modulation type="PSK") -> (matched filter coefficients=w43)
  call "1D Convolution (CDB).gvi"(x=w34, y=w43) -> (x * y=w44)
  Build Waveform Node(Y=w44, dt=w42) -> (output waveform=w45)
  $"Baseband Output" <- w45
  w46 = cluster{"t0": timestamp, "dt": f64, "Y": c128[]} {all zero or empty}
  Property Node(instance in=w46, "dt"=w42, "Y"=w44) -> (instance out=w47)
  call "FFT Power Spectrum for 1 Chan (CDB)2.gvi"(time signal=w47, dB On (F)=TRUE) -> (power spectrum=w48)
  $"output baseband Power Spectrum" <- w48
  call "PulseAlign.gvi"(Input signal=w44, Receiver Sampling Factor=w7) -> (aligned output=w49)
  call "Decimate (single shot, CDB).gvi"(input array=w49, decimating factor=w7) -> (decimated array=w50)
  s2 = 1+0i  # shift register
  for {
    w51 = each element of w50
    Complex Conjugate(x + iy=s2) -> w53
    Multiply(w51, w53) -> w54
    append w54 to w52
    next s2 = w54
  }
  call "FrameSync.gvi"(Sampled Input=w52) -> (Aligned Samples=w55)
  Complex To Real Imaginary(x + iy=w55) -> (x=w56)
  for {
    w57 = each element of w56
    Is Greater Than 0(x=w57) -> w59
    Boolean To Integer(Boolean=w59) -> (0, 1=w60)
    append w60 to w58
  }
  Array Subset(array=w58, index0=0, length0=$"total bits") -> w61
  $"output bit stream" <- w61
  call "MT Calculate BER After Trigger (Fibonacci PN Sequence).gvi"(input bit stream=w61, BER trigger threshold=0.4) -> (BER=w62, trigger found?=w63)
  $BER <- w62
  $"trigger found?" <- w63
